# Dynamo graph AQTO_A Model Prep Debug.dyn (Dynamo 2.6.1.8786)
# packages: BumbleBee 2021.25.3, Clockwork for Dynamo 2.x 2.3.0, archi-lab.net 2021.25.19

# group: SET
# note: Set parameter values of Revit Objects

# group: INSPECT
# note: Debug nodes

# group: OUTPUT
# note: Object/ data creation in host application

# group: TEMP
# note: Internal notes

# group: FUNCTION
# note: Data manipulation

# group: INPUT
# note: Data input

# group: GET
# note: Get objects and data from Revit

# group: Create Material Takeoff
boolean = BoolSelector(true)
code_block = CodeBlock { "**Material Takeoff"; }
python_script = Python(IN[0]=boolean, IN[1]=code_block)
# ---------- python_script.python (22 lines) ----------
# Load the Python Standard and DesignScript Libraries
import clr

clr.AddReference('RevitAPI')
from Autodesk.Revit.DB import *

clr.AddReference('RevitServices')
import RevitServices
from RevitServices.Persistence import DocumentManager
from RevitServices.Transactions import TransactionManager

doc = DocumentManager.Instance.CurrentDBDocument
id = ElementId.InvalidElementId

if IN[0]:
	TransactionManager.Instance.EnsureInTransaction(doc)
	newschedule = ViewSchedule.CreateMaterialTakeoff(doc,id)
	newschedule.Name = IN[1]
	OUT = newschedule
else:
	OUT = "Set IN[0] to true!"
	
# ----------------------------------------
watch = Watch(python_script)

# group: Get Visible Model Elements
all_elements_in_active_view = ElementsInView()
categories = Categories("OST_MEPSpaces")
all_elements_of_category = ElementsOfCategory(Category=categories)

# group: Input Custom Parameters
code_block_2 = CodeBlock { "**ElementID"; "**Category"; "**Division"; "**DB Key"; }
list_create = List.Create(item0=code_block_2.out0, item1=code_block_2.out1, item2=code_block_2.out2, item3=code_block_2.out3)
code_block_3 = CodeBlock { "Project Parameters"; }
select_parameter_type = ParameterType("Integer")
select_parameter_type_2 = ParameterType("Text")
select_builtin_parameter_group = BuiltInParameterGroup("PG_IDENTITY_DATA")
code_block_4 = CodeBlock { true; }

# group: Get Parameters in Project
code_block_5 = CodeBlock { true; }
projectParameters = Custom[Document.ProjectParameters](toggle=code_block_5)  # package Clockwork for Dynamo 2.x; Retrieves all project parameters and the categories they have been assigned to

# group: Filter out existing parameters in model
watch_2 = Watch(projectParameters.paramName)
code_block_6 = CodeBlock { "**"; }
contains = String.Contains(str=watch_2, searchFor=code_block_6)
filterByBoolMask = List.FilterByBoolMask(list=watch_2, mask=contains)
setDifference = List.SetDifference(list1=list_create, list2=filterByBoolMask.in)

# group (continued): Input Custom Parameters
contains_2 = List.Contains(list=setDifference, item=code_block_2.out0, lacing=CrossProduct)
if_ = If(test=contains_2, true=select_parameter_type, false=select_parameter_type_2)

# group: Write Parameters to project
createProjectParameterForAllCategories = Parameter.CreateProjectParameterForAllCategories(parameterName=setDifference, groupName=code_block_3, type=if_, group=select_builtin_parameter_group, instance=code_block_4)

# group: 2 - Write Element ID + Category keys to Element Parameters
list_create_2 = List.Create(item0=all_elements_in_active_view, item1=all_elements_of_category)
flatten = List.Flatten(list=list_create_2)
id = Element.Id(element=flatten)
getCategory = Element.GetCategory(element=flatten)
string_from_object = FromObject(obj=getCategory)
list_create_3 = List.Create(item0=id, item1=string_from_object)
passthrough = Custom[Passthrough](passThrough=list_create_3, waitFor=createProjectParameterForAllCategories)  # package Clockwork for Dynamo 2.x; Forces a sequential order of execution. The node wired into the output of the Passthrough node will be executed *after* the node wired into the waitFor input (e.g. important for some Revit operations). The value of the passThrough input will be passed on to the node wired into the output port of the Passthrough node.
list_create_4 = List.Create(item0=code_block_2.out0, item1=code_block_2.out1)
setParameterByName = Element.SetParameterByName(element=flatten, parameterName=list_create_4@L1, value=list_create_3@L2)

# group: 1 - SET UNITS
boolean_2 = BoolSelector(true)
python_script_2 = Python(IN[0]=boolean_2)
# ---------- python_script_2.python (36 lines) ----------
# Load the Python Standard and DesignScript Libraries
import clr

clr.AddReference('RevitAPI')
from Autodesk.Revit.DB import *

clr.AddReference('RevitServices')
import RevitServices
from RevitServices.Persistence import DocumentManager
from RevitServices.Transactions import TransactionManager

doc = DocumentManager.Instance.CurrentDBDocument

if IN[0]:
	TransactionManager.Instance.EnsureInTransaction(doc)
	unit = doc.GetUnits()
	format = FormatOptions(DisplayUnitType.DUT_DECIMAL_FEET,UnitSymbolType.UST_NONE,0.1)
	unit.SetFormatOptions(UnitType.UT_Length,format)
	doc.SetUnits(unit)
	unit = doc.GetUnits()
	format = FormatOptions(DisplayUnitType.DUT_CUBIC_YARDS,UnitSymbolType.UST_NONE,0.1)
	unit.SetFormatOptions(UnitType.UT_Volume,format)
	doc.SetUnits(unit)
	unit = doc.GetUnits()
	format = FormatOptions(DisplayUnitType.DUT_SQUARE_FEET,UnitSymbolType.UST_NONE,0.01)
	unit.SetFormatOptions(UnitType.UT_Area,format)
	doc.SetUnits(unit)
	unit = doc.GetUnits()
	format = FormatOptions(DisplayUnitType.DUT_POUNDS_MASS_PER_CUBIC_FOOT,UnitSymbolType.UST_NONE,0.1)
	unit.SetFormatOptions(UnitType.UT_MassDensity,format)
	doc.SetUnits(unit)
	TransactionManager.Instance.TransactionTaskDone()
	OUT = "UNITS FORMATTED FOR AQTO SCRIPT"
else:
	OUT = "Set IN[0] to true!"
	
# ----------------------------------------

# group: Delete Existing ** Schedules
view_type = ViewTypesUi("Schedule")
getByType = archilab.Revit.Views.Views.GetByType(viewType=view_type)
string_from_object_2 = FromObject(obj=getByType)
code_block_7 = CodeBlock { "**"; }
contains_3 = String.Contains(str=string_from_object_2, searchFor=code_block_7, lacing=CrossProduct)
filterByBoolMask_2 = List.FilterByBoolMask(list=getByType, mask=contains_3)
delete = archilab.Revit.Elements.Elements.Delete(element=filterByBoolMask_2.in)
passthrough_2 = Custom[Passthrough](passThrough=view_type, waitFor=setParameterByName)

# group: Get all Categories in View + ADD SPACES
passthrough_3 = Custom[Passthrough](passThrough=all_elements_in_active_view, waitFor=delete)
getCategory_2 = Element.GetCategory(element=all_elements_in_active_view)
uniqueItems = List.UniqueItems(list=getCategory_2)
categories_2 = Categories("OST_MEPSpaces")
code_block_8 = CodeBlock { 0; }

insert = List.Insert(list=uniqueItems, element=categories_2, index=code_block_8)

# group (continued): Get all Categories in View + ADD SPACES
watch_3 = Watch(insert)
string_from_object_3 = FromObject(obj=insert)

# group: Excel Sheet of all Schedulable Revit Categories
file_path = Filename("..\..\..\..\..\Egnyte\Shared\Digital Construction Team\00_Digital Assets\00_DYNAMO\excel\List of Schedulable Revit Categories.xlsx")
file_from_path = FileObject(path=file_path)
boolean_3 = BoolSelector(true)
get_worksheet_names = Custom[Get Worksheet Names](filePath=file_path, runIt=boolean_3)  # package BumbleBee; This node will query an Excel file and return a list of sheet names that it contains.
firstItem = List.FirstItem(list=get_worksheet_names)
boolean_4 = BoolSelector(false)
importExcel = Data.ImportExcel(file=file_from_path, sheetName=firstItem, readAsStrings=boolean_3, showExcel=boolean_4)
flatten_2 = List.Flatten(list=importExcel)

# group: Filter out non-schedulable categories
setIntersection = List.SetIntersection(list1=string_from_object_3, list2=flatten_2)
contains_4 = List.Contains(list=string_from_object_3, item=setIntersection, lacing=CrossProduct)
anyTrue = Custom[Booleans.AnyTrue](seq=contains_4)  # package Clockwork for Dynamo 2.x; Returns true if any item in a list of booleans is true.
filterByBoolMask_3 = List.FilterByBoolMask(list=watch_3, mask=anyTrue)

# group: Creating Schedule Names
concat = String.Concat()  # unwired: string0, string1, string2
code_block_9 = CodeBlock { "**"; " Schedule"; }
count = List.Count(list=setIntersection)
cycle = List.Cycle(list=code_block_9.out0, amount=count)
cycle_2 = List.Cycle(list=code_block_9.out1, amount=count)
combine = List.Combine(comb=concat, list1=cycle, list2=setIntersection, list3=cycle_2)

# group: Create Category Schedules
schedule_type = ScheduleTypes("RegularSchedule")
createSchedule = ScheduleView.CreateSchedule(category=filterByBoolMask_3.in, name=combine, scheduleType=schedule_type)

# group: rewrite schedule parameters WIP
view_type_2 = ViewTypesUi("Schedule")  # frozen
passthrough_4 = Custom[Passthrough](passThrough=view_type_2, waitFor=createSchedule)
getByType_2 = archilab.Revit.Views.Views.GetByType(viewType=passthrough_4)
string_from_object_4 = FromObject(obj=getByType_2)
contains_5 = String.Contains(str=string_from_object_4, searchFor=combine, lacing=CrossProduct)
anyTrue_2 = Custom[Booleans.AnyTrue](seq=contains_5)
filterByBoolMask_4 = List.FilterByBoolMask(list=getByType_2, mask=anyTrue_2)

# group: Combine Schedules, toggle link elements
join = List.Join(list0=createSchedule, list1=python_script)
python_script_3 = Python(IN[0]=join)
# ---------- python_script_3.python (41 lines) ----------
# Enable Python support and load DesignScript library
import clr
clr.AddReference('ProtoGeometry')
from Autodesk.DesignScript.Geometry import *

clr.AddReference('RevitAPI')
from Autodesk.Revit.DB import *
from Autodesk.Revit.DB.Structure import *

clr.AddReference('RevitAPIUI')
from Autodesk.Revit.UI import *

clr.AddReference('RevitServices')
import RevitServices
from RevitServices.Persistence import DocumentManager
from RevitServices.Transactions import TransactionManager

doc = DocumentManager.Instance.CurrentDBDocument
uidoc=DocumentManager.Instance.CurrentUIApplication.ActiveUIDocument

schedules = UnwrapElement(IN[0])

out = []
report = []

for schedule in schedules:
	if schedule.Definition.CanIncludeLinkedFiles:
		try:
			TransactionManager.Instance.EnsureInTransaction(doc)
			schedule.Definition.IncludeLinkedFiles = True
			TransactionManager.Instance.TransactionTaskDone()
			out.append(schedule)
			report.append(True)
		except:
			out.append(schedule)
			report.append(False)	
	else:
		out.append(schedule)
		report.append(False)

OUT = out, report
# ----------------------------------------
code_block_10 = CodeBlock { 0; }
getItemAtIndex = List.GetItemAtIndex(list=python_script_3@L3, index=code_block_10)
flatten_3 = List.Flatten(list=getItemAtIndex)

# group: Fields to Schedule
schedulableFields = ScheduleView.SchedulableFields(scheduleView=flatten_3)
code_block_11 = CodeBlock()
# ---------- code_block_11.designscript (15 lines) ----------
"**Division";
"**Category";
"Family and Type";
"Level";
"Base Constraint";
"Length";
"Area";
"Volume";
"IfcName";
"Count";
"Material: Name";
"Material: Area";
"Material: Volume";
"**DB Key";
"**ElementID";
# ----------------------------------------
list_create_5 = List.Create(item0=code_block_11.out0, item1=code_block_11.out1, item2=code_block_11.out2, item3=code_block_11.out3, item4=code_block_11.out4, item5=code_block_11.out5, item6=code_block_11.out6, item7=code_block_11.out7, item8=code_block_11.out8, item9=code_block_11.out9, item10=code_block_11.out10, item11=code_block_11.out11, item12=code_block_11.out13, item13=code_block_11.out14)

# group: All Indices (by Schedule) of Fields
string_from_object_5 = FromObject(obj=schedulableFields)
allIndicesOf = List.AllIndicesOf(list=string_from_object_5@L2, item=list_create_5)
code_block_12 = CodeBlock { 0; }
getItemAtIndex_2 = List.GetItemAtIndex(list=allIndicesOf@@L2, index=code_block_12)
getItemAtIndex_3 = List.GetItemAtIndex(list=schedulableFields@L2, index=getItemAtIndex_2@L2)

# group: 3 - Add Fields to Schedules
addFields = ScheduleView.AddFields(scheduleView=flatten_3, fields=getItemAtIndex_3)

# group: Sort fields by "Family and Type"
passthrough_5 = Custom[Passthrough](passThrough=flatten_3, waitFor=addFields)
code_block_13 = CodeBlock { "Family and Type"; false; true; "Ascending"; }
schedule_sorting_grouping = Custom[Schedule Sorting Grouping](schedule=passthrough_5, parameterName=code_block_13.out0, blankLine=code_block_13.out1, footerCount=code_block_13.out1, footerTitle=code_block_13.out1, header=code_block_13.out1, sortOrder=code_block_13.out3, lacing=CrossProduct)  # package archi-lab.net; This node will allow you to specify sorting/grouping parameters in schedule as well parameters like sorting order, whether its a footer or header. Visit archi-lab.net for more information.
watch_4 = Watch(schedule_sorting_grouping)
